# Grasshopper definition A2_GHDefinition1.gh (Grasshopper 1.0.7)

# Here's the gap thickness you can vary ⬆️
number_slider = Slider(3.2, range=0..8)
number = Number(0.9424777961)
number_2 = Number(5)
number_3 = Number(7)
number_4 = Number(60)
sine = Sine(Value=number)
number_5 = Number(-2)
polygon = Polygon(Plane=PlaneXY(0, 0, 0), Radius=number_4, Segments=number_2, FilletRadius=0)  # -> Polygon, Length
rectangle = Rectangle(Plane=PlaneXY(0, 0, 0), XSize=number_slider, YSize=number_3, Radius=0)  # -> Rectangle, Length
multiplication = Multiplication(A=sine, B=number_4)
division = Division(A=number_slider, B=number_5)
subtraction = Subtraction(A=number_3, B=multiplication)
number_6 = Number(1.570796327)
vector_xyz = VectorXYZ(XComponent=subtraction, YComponent=division, ZComponent=0)  # -> Vector, Length
rotate = Rotate(Geometry=rectangle.Rectangle, Angle=number_6, Plane=PlaneXY(0, 0, 0))  # -> Geometry, Transform
move = Move(Geometry=rotate.Geometry, Motion=vector_xyz.Vector)  # -> Geometry, Transform
polar_array = PolarArray(Geometry=move.Geometry, Plane=PlaneXY(0, 0, 0), Count=number_2, Angle=6.283185307)  # -> Geometry, Transform
trim_with_regions = TrimWithRegions(Curve=polar_array.Geometry, Regions=polygon.Polygon)  # -> flatten(Inside), Outside
trim_with_regions_2 = TrimWithRegions(Curve=polygon.Polygon, Regions=polar_array.Geometry)  # -> Inside, flatten(Outside)
join_curves = JoinCurves(Curves=[trim_with_regions.Inside, trim_with_regions_2.Outside], Preserve=False)
panel = Panel("Bake this ⬅️")
