# Grasshopper definition A2_GHDefinition3.gh (Grasshopper 1.0.7)

number = Number(0.9424777961)
number_2 = Number(0.9424777961)
number_3 = Number(0.9424777961)
number_4 = Number(0.9424777961)
sine = Sine(Value=number)
sine_2 = Sine(Value=number_2)
cosine = Cosine(Value=number_3)
cosine_2 = Cosine(Value=number_4)
number_5 = Number(30)
number_6 = Number(15)
number_7 = Number(15)
number_8 = Number(30)
multiplication = Multiplication(A=sine, B=number_5)
multiplication_2 = Multiplication(A=sine_2, B=number_6)
multiplication_3 = Multiplication(A=cosine, B=number_7)
multiplication_4 = Multiplication(A=cosine_2, B=number_8)
construct_point = ConstructPoint(XCoordinate=multiplication, YCoordinate=multiplication_4, ZCoordinate=0)
construct_point_2 = ConstructPoint(XCoordinate=multiplication_2, YCoordinate=multiplication_3, ZCoordinate=0)
construct_point_3 = ConstructPoint(XCoordinate=multiplication, YCoordinate=0, ZCoordinate=0)
construct_point_4 = ConstructPoint(XCoordinate=multiplication_2, YCoordinate=0, ZCoordinate=0)
line = Line(StartPoint=construct_point, EndPoint=construct_point_2)
line_2 = Line(StartPoint=construct_point_3, EndPoint=construct_point_4)
line_3 = Line(StartPoint=construct_point_4, EndPoint=construct_point_2)
line_4 = Line(StartPoint=construct_point_3, EndPoint=construct_point)
join_curves = JoinCurves(Curves=[line_2, line_4, line_3, line], Preserve=False)
addition = Addition(A=multiplication, B=multiplication_2)
# Here's the gap thickness which you can vary ⬇️
number_9 = Number(2)
number_slider = Slider(3.2, range=0..8)
division = Division(A=addition, B=number_9)
number_10 = Number(7)
number_11 = Number(2)
division_2 = Division(A=number_slider, B=number_11)
rectangle = Rectangle(Plane=PlaneXY(0, 0, 0), XSize=number_slider, YSize=number_10, Radius=0)  # -> Rectangle, Length
subtraction = Subtraction(A=division, B=division_2)
vector_xyz = VectorXYZ(XComponent=subtraction, YComponent=0, ZComponent=0)  # -> Vector, Length
move = Move(Geometry=rectangle.Rectangle, Motion=vector_xyz.Vector)  # -> Geometry, Transform
trim_with_regions = TrimWithRegions(Curve=move.Geometry, Regions=join_curves)  # -> Inside, Outside
trim_with_regions_2 = TrimWithRegions(Curve=join_curves, Regions=move.Geometry)  # -> Inside, Outside
join_curves_2 = JoinCurves(Curves=[trim_with_regions_2.Outside, trim_with_regions.Inside], Preserve=False)
mirror_curve = MirrorCurve(Geometry=join_curves_2, Curve=line, Tangent=True)
join_curves_3 = JoinCurves(Curves=[join_curves_2, mirror_curve], Preserve=False)
panel = Panel("Bake this ⬅️")
