# Grasshopper definition LargeBottom.gh (Grasshopper 1.0.7)

material_thickness = Slider(5, range=0..10)
number_slider = Slider(160, range=0..1000)
number_slider_2 = Slider(160, range=0..1000)
no_of_fingers = Number(10)
number = Number(2)
division = Division(A=number_slider, B=no_of_fingers)
multiplication = Multiplication(A=division, B=number)
rectangle = Rectangle(Plane=PlaneXY(0, 0, 0), XSize=material_thickness, YSize=division, Radius=0)  # -> Rectangle, Length
rectangle_2 = Rectangle(Plane=PlaneXY(0, 0, 0), XSize=material_thickness, YSize=division, Radius=0)  # -> Rectangle, Length
rectangle_3 = Rectangle(Plane=PlaneXY(0, 0, 0), XSize=number_slider_2, YSize=number_slider, Radius=0)  # -> Rectangle, Length
vector_xyz = VectorXYZ(XComponent=0, YComponent=multiplication, ZComponent=0)  # -> Vector, Length
move = Move(Geometry=rectangle.Rectangle, Motion=vector_xyz.Vector)  # -> Geometry, Transform
move_2 = Move(Geometry=move.Geometry, Motion=vector_xyz.Vector)  # -> Geometry, Transform
move_3 = Move(Geometry=move_2.Geometry, Motion=vector_xyz.Vector)  # -> Geometry, Transform
move_4 = Move(Geometry=move_3.Geometry, Motion=vector_xyz.Vector)  # -> Geometry, Transform
move_5 = Move(Geometry=move.Geometry, Motion=vector_xyz.Vector)  # -> Geometry, Transform
move_6 = Move(Geometry=move_2.Geometry, Motion=vector_xyz.Vector)  # -> Geometry, Transform
move_7 = Move(Geometry=rectangle.Rectangle, Motion=vector_xyz.Vector)  # -> Geometry, Transform
number_2 = Number(2)
division_2 = Division(A=division, B=number_2)
group = Group(Objects=[rectangle_2.Rectangle, move_7.Geometry, move_5.Geometry, move_6.Geometry, move_4.Geometry])
vector_xyz_2 = VectorXYZ(XComponent=0, YComponent=division_2, ZComponent=0)  # -> Vector, Length
mirror = Mirror(Geometry=group, Plane=PlaneYZ(0, 0, 0))  # -> Geometry, Transform
vector_xyz_3 = VectorXYZ(XComponent=number_slider_2, YComponent=0, ZComponent=0)  # -> Vector, Length
move_8 = Move(Geometry=mirror.Geometry, Motion=vector_xyz_3.Vector)  # -> Geometry, Transform
move_9 = Move(Geometry=[group, move_8.Geometry], Motion=vector_xyz_2.Vector)  # -> Geometry, Transform
rotate = Rotate(Geometry=move_9.Geometry, Angle=1.570796327, Plane=PlaneXY(0, 0, 0))  # -> Geometry, Transform
vector_xyz_4 = VectorXYZ(XComponent=number_slider_2, YComponent=0, ZComponent=0)  # -> Vector, Length
move_10 = Move(Geometry=rotate.Geometry, Motion=vector_xyz_4.Vector)  # -> Geometry, Transform
group_2 = Group(BAKETHIS=[move_10.Geometry, move_9.Geometry, rectangle_3.Rectangle])
