# Grasshopper definition SmallBottom.gh (Grasshopper 1.0.7)

material_thickness = Slider(5, range=0..10)
number_slider = Slider(160, range=0..1000)
number_slider_2 = Slider(80, range=0..1000)
no_of_fingers = Number(10)
number = Number(2)
division = Division(A=number_slider, B=no_of_fingers)
multiplication = Multiplication(A=division, B=number)
rectangle = Rectangle(Plane=PlaneXY(0, 0, 0), XSize=material_thickness, YSize=division, Radius=0)  # -> Rectangle, Length
rectangle_2 = Rectangle(Plane=PlaneXY(0, 0, 0), XSize=material_thickness, YSize=division, Radius=0)  # -> Rectangle, Length
rectangle_3 = Rectangle(Plane=PlaneXY(0, 0, 0), XSize=number_slider_2, YSize=number_slider, Radius=0)  # -> Rectangle, Length
vector_xyz = VectorXYZ(XComponent=0, YComponent=multiplication, ZComponent=0)  # -> Vector, Length
move = Move(Geometry=rectangle.Rectangle, Motion=vector_xyz.Vector)  # -> Geometry, Transform
move_2 = Move(Geometry=move.Geometry, Motion=vector_xyz.Vector)  # -> Geometry, Transform
move_3 = Move(Geometry=move_2.Geometry, Motion=vector_xyz.Vector)  # -> Geometry, Transform
move_4 = Move(Geometry=move_3.Geometry, Motion=vector_xyz.Vector)  # -> Geometry, Transform
move_5 = Move(Geometry=move.Geometry, Motion=vector_xyz.Vector)  # -> Geometry, Transform
move_6 = Move(Geometry=move_2.Geometry, Motion=vector_xyz.Vector)  # -> Geometry, Transform
move_7 = Move(Geometry=rectangle.Rectangle, Motion=vector_xyz.Vector)  # -> Geometry, Transform
number_2 = Number(2)
division_2 = Division(A=division, B=number_2)
group = Group(Objects=[rectangle_2.Rectangle, move_7.Geometry, move_5.Geometry, move_6.Geometry, move_4.Geometry])
vector_xyz_2 = VectorXYZ(XComponent=0, YComponent=division_2, ZComponent=0)  # -> Vector, Length
rotate = Rotate(Geometry=[move_7.Geometry, rectangle_2.Rectangle], Angle=1.570796327, Plane=PlaneXY(0, 0, 0))  # -> Geometry, Transform
subtraction = Subtraction(A=number_slider_2, B=division)
mirror = Mirror(Geometry=group, Plane=PlaneYZ(0, 0, 0))  # -> Geometry, Transform
vector_xyz_3 = VectorXYZ(XComponent=number_slider_2, YComponent=0, ZComponent=0)  # -> Vector, Length
vector_xyz_4 = VectorXYZ(XComponent=subtraction, YComponent=0, ZComponent=0)  # -> Vector, Length
move_8 = Move(Geometry=rotate.Geometry, Motion=vector_xyz_4.Vector)  # -> Geometry, Transform
move_9 = Move(Geometry=mirror.Geometry, Motion=vector_xyz_3.Vector)  # -> Geometry, Transform
move_10 = Move(Geometry=[group, move_9.Geometry], Motion=vector_xyz_2.Vector)  # -> Geometry, Transform
addition = Addition(A=subtraction, B=division)
subtraction_2 = Subtraction(A=number_slider, B=material_thickness)
mirror_2 = Mirror(Geometry=move_8.Geometry, Plane=PlaneYZ(0, 0, 0))  # -> Geometry, Transform
vector_xyz_5 = VectorXYZ(XComponent=addition, YComponent=subtraction_2, ZComponent=0)  # -> Vector, Length
move_11 = Move(Geometry=mirror_2.Geometry, Motion=vector_xyz_5.Vector)  # -> Geometry, Transform
group_2 = Group(BAKETHIS=[move_10.Geometry, rectangle_3.Rectangle, move_11.Geometry, move_8.Geometry])
