# Grasshopper definition SmallSide.gh (Grasshopper 1.0.7)

material_thickness = Slider(5, range=0..10)
no_2_of_fingers = Number(4)
number_slider = Slider(80, range=0..1000)
number_slider_2 = Slider(40, range=0..1000)
no_of_fingers = Number(5)
number = Number(2)
number_2 = Number(2)
division = Division(A=number_slider_2, B=no_2_of_fingers)
multiplication = Multiplication(A=division, B=number)
division_2 = Division(A=number_slider, B=no_of_fingers)
multiplication_2 = Multiplication(A=division_2, B=number_2)
vector_xyz = VectorXYZ(XComponent=0, YComponent=multiplication, ZComponent=0)  # -> Vector, Length
vector_xyz_2 = VectorXYZ(XComponent=multiplication_2, YComponent=0, ZComponent=0)  # -> Vector, Length
rectangle = Rectangle(Plane=PlaneXY(0, 0, 0), XSize=material_thickness, YSize=division, Radius=0)  # -> Rectangle, Length
rectangle_2 = Rectangle(Plane=PlaneXY(0, 0, 0), XSize=number_slider, YSize=number_slider_2, Radius=0)  # -> Rectangle, Length
rectangle_3 = Rectangle(Plane=PlaneXY(0, 0, 0), XSize=material_thickness, YSize=division, Radius=0)  # -> Rectangle, Length
rectangle_4 = Rectangle(Plane=PlaneXY(0, 0, 0), XSize=division_2, YSize=material_thickness, Radius=0)  # -> Rectangle, Length
rectangle_5 = Rectangle(Plane=PlaneXY(0, 0, 0), XSize=division_2, YSize=material_thickness, Radius=0)  # -> Rectangle, Length
move = Move(Geometry=rectangle_5.Rectangle, Motion=vector_xyz_2.Vector)  # -> Geometry, Transform
move_2 = Move(Geometry=rectangle.Rectangle, Motion=vector_xyz.Vector)  # -> Geometry, Transform
move_3 = Move(Geometry=move.Geometry, Motion=vector_xyz_2.Vector)  # -> Geometry, Transform
move_4 = Move(Geometry=rectangle_5.Rectangle, Motion=vector_xyz_2.Vector)  # -> Geometry, Transform
subtraction = Subtraction(A=number_slider, B=material_thickness)
vector_xyz_3 = VectorXYZ(XComponent=0, YComponent=multiplication, ZComponent=0)  # -> Vector, Length
vector_xyz_4 = VectorXYZ(XComponent=subtraction, YComponent=division, ZComponent=0)  # -> Vector, Length
rectangle_6 = Rectangle(Plane=PlaneXY(0, 0, 0), XSize=material_thickness, YSize=division, Radius=0)  # -> Rectangle, Length
move_5 = Move(Geometry=rectangle_6.Rectangle, Motion=vector_xyz_4.Vector)  # -> Geometry, Transform
group = Group(Objects=[rectangle_4.Rectangle, move_4.Geometry, move_3.Geometry])
move_6 = Move(Geometry=rectangle_6.Rectangle, Motion=vector_xyz_4.Vector)  # -> Geometry, Transform
move_7 = Move(Geometry=move_5.Geometry, Motion=vector_xyz_3.Vector)  # -> Geometry, Transform
group_2 = Group(BAKETHIS=[move_6.Geometry, move_7.Geometry, move_2.Geometry, rectangle_3.Rectangle, rectangle_2.Rectangle, group])
